# Grasshopper definition 9.11_ElkMap.gh (Grasshopper 1.0.4)
# plug-ins: ElkGHComponents

path = FilePath("D:\Documents\Design\ThesisProject\map.osm")
path_2 = FilePath("D:\Documents\Design\ThesisProject\n38_w124_1arc_v3.tif")
loc = Location(FilePathText=path)  # -> OSMPointData, OSMFile, LongitudeDomain, LatitudeDomain
topo = Topography(FilePath=path_2, Longitude=loc.LongitudeDomain, Latitude=loc.LatitudeDomain)  # -> FileInfo, Points, Curves, Surface
crv = Curve(topo.Curves)
srf = Surface(topo.Surface)
pline = PolyLine(Closed=False)
osm = OSMData(OSMPointData=loc.OSMPointData, OSMFilePath=loc.OSMFile, Feature="building", Generate3d=True, IndividualOutputs=False)  # -> Ways, Buildings, FeatureKey
osm_2 = OSMData(
    OSMPointData=loc.OSMPointData,
    OSMFilePath=loc.OSMFile,
    Feature="highway",
    Generate3d=False,
    IndividualOutputs=False,
    SelectedTypes=["crossing", "living_street", "motorway", "motorway_junction", "motorway_link", "passing_place", "primary", "primary_link", "residential", "rest_area", "road", "secondary", "secondary_link", "service", "services", "street_lamp", "tertiary", "tertiary_link", "traffic_signal", "trunk", "trunk_link", "unclassified"])  # -> Ways, FeatureKey
osm_3 = OSMData(OSMPointData=loc.OSMPointData, OSMFilePath=loc.OSMFile, Feature="natural", Generate3d=False, IndividualOutputs=False)  # -> Ways, FeatureKey
offset = Offset(Distance=0, Retrim=True)
brep = Brep(osm.Buildings)
pline_2 = PolyLine(Vertices=osm_3.Ways, Closed=False)
pline_3 = PolyLine(Vertices=osm_2.Ways, Closed=False)
pline_4 = PolyLine(Vertices=osm.Ways, Closed=False)
trim = TrimWithBrep(Curve=[pline_3, pline_2], Brep=<geometry referenced from the Rhino model>)  # -> Inside, Outside
offset_2 = Offset(Curve=trim.Inside, Distance="10", Plane=PlaneXY(0, 0, 0), Corners=3)
offset_3 = Offset(Curve=trim.Inside, Distance="-10", Plane=PlaneXY(0, 0, 0), Corners=3)
offset_4 = Offset(Distance=-18, Plane=PlaneXY(0, 0, 0), Corners=1)
pull = PullCurve(Curve=offset_3, Surface=srf)
panel = Panel(osm_2.FeatureKey)
offsets = OffsetOnSrf(Curve=pull, Distance=18, Surface=srf)
pull_2 = PullCurve(Curve=[pline_2, pline_4], Surface=srf)
pull_3 = PullCurve(Curve=pline_3, Surface=srf)
offset_5 = Offset(Distance=18, Plane=PlaneXY(0, 0, 0), Corners=1)
