# Grasshopper definition 9.6_SensesDefinition.gh (Grasshopper 1.0.4)

reduction = Slider(0.023, range=0..0.1)
highway_1 = Sensation(
    sight=Slider(60, range=0..100),
    sound=Slider(40, range=0..100),
    smell=Slider(0, range=0..100),
    touch=Slider(0, range=0..100),
    taste=Slider(0, range=0..100))  # -> sight_2, sound_2, smell_2, touch_2, taste_2, sensedata, remaining_points
humidity = Sensation(
    sight=Slider(0, range=0..100),
    sound=Slider(0, range=0..100),
    smell=Slider(10, range=0..100),
    touch=Slider(90, range=0..100),
    taste=Slider(0, range=0..100))  # -> sight_2, sound_2, smell_2, touch_2, taste_2, sensedata, remaining_points
rain = Sensation(
    sight=Slider(25, range=0..100),
    sound=Slider(30, range=0..100),
    smell=Slider(25, range=0..100),
    touch=Slider(20, range=0..100),
    taste=Slider(0, range=0..100))  # -> sight_2, sound_2, smell_2, touch_2, taste_2, sensedata, remaining_points
nature = Sensation(
    sight=Slider(60, range=0..100),
    sound=Slider(20, range=0..100),
    smell=Slider(10, range=0..100),
    touch=Slider(10, range=0..100),
    taste=Slider(0, range=0..100))  # -> sight_2, sound_2, smell_2, touch_2, taste_2, sensedata, remaining_points
ocean = Sensation(
    sight=Slider(50, range=0..100),
    sound=Slider(30, range=0..100),
    smell=Slider(15, range=0..100),
    touch=Slider(5, range=0..100),
    taste=Slider(0, range=0..100))  # -> sight_2, sound_2, smell_2, touch_2, taste_2, sensedata, remaining_points
breeze = Sensation(
    sight=Slider(10, range=0..100),
    sound=Slider(30, range=0..100),
    smell=Slider(10, range=0..100),
    touch=Slider(50, range=0..100),
    taste=Slider(0, range=0..100))  # -> sight_2, sound_2, smell_2, touch_2, taste_2, sensedata, remaining_points
panel = Panel(highway_1.remaining_points)
panel_2 = Panel(humidity.remaining_points)
panel_3 = Panel(rain.remaining_points)
panel_4 = Panel(ocean.remaining_points)
panel_5 = Panel(nature.remaining_points)
panel_6 = Panel(breeze.remaining_points)
sight = Sight(sense=[ocean.sight_2, breeze.sight_2, humidity.sight_2, highway_1.sight_2, rain.sight_2, nature.sight_2])  # -> total_sensation, list
sound = Sight(sense=[ocean.sound_2, breeze.sound_2, humidity.sound_2, highway_1.sound_2, rain.sound_2, nature.sound_2])  # -> total_sensation, list
taste = Sight(sense=[ocean.taste_2, breeze.taste_2, humidity.taste_2, highway_1.taste_2, rain.taste_2, nature.taste_2])  # -> total_sensation, list
smell = Sight(sense=[ocean.smell_2, breeze.smell_2, humidity.smell_2, highway_1.smell_2, rain.smell_2, nature.smell_2])  # -> total_sensation, list
touch = Sight(sense=[ocean.touch_2, breeze.touch_2, humidity.touch_2, highway_1.touch_2, rain.touch_2, nature.touch_2])  # -> total_sensation, list
panel_7 = Panel(sound.list)
panel_8 = Panel(smell.total_sensation)
panel_9 = Panel(touch.total_sensation)
panel_10 = Panel(sight.total_sensation)
panel_11 = Panel(sight.list)
panel_12 = Panel(sound.total_sensation)
panel_13 = Panel(touch.list)
panel_14 = Panel(taste.total_sensation)
panel_15 = Panel(smell.list)
panel_16 = Panel(taste.list)
multiplication = Multiplication(A=panel_8, B=reduction)
multiplication_2 = Multiplication(A=panel_14, B=reduction)
multiplication_3 = Multiplication(A=panel_10, B=reduction)
multiplication_4 = Multiplication(A=panel_9, B=reduction)
multiplication_5 = Multiplication(A=panel_12, B=reduction)
panel_17 = Panel(multiplication)
panel_18 = Panel(multiplication_4)
panel_19 = Panel(multiplication_2)
panel_20 = Panel(multiplication_3)
panel_21 = Panel(multiplication_5)
offset = Offset(Curve=<geometry referenced from the Rhino model>, Distance=panel_18, Plane=PlaneXY(0, 0, 0), Corners=1)
offset_2 = Offset(Curve=<geometry referenced from the Rhino model>, Distance=panel_19, Plane=PlaneXY(0, 0, 0), Corners=1)
offset_3 = Offset(Curve=<geometry referenced from the Rhino model>, Distance=panel_17, Plane=PlaneXY(0, 0, 0), Corners=1)
offset_4 = Offset(Curve=<geometry referenced from the Rhino model>, Distance=panel_20, Plane=PlaneXY(0, 0, 0), Corners=1)
offset_5 = Offset(Curve=<geometry referenced from the Rhino model>, Distance=panel_21, Plane=PlaneXY(0, 0, 0), Corners=1)
len = Length(Curve=offset_4)
len_2 = Length(Curve=offset)
len_3 = Length(Curve=offset_3)
len_4 = Length(Curve=offset_5)
len_5 = Length(Curve=offset_2)
panel_22 = Panel(len)
panel_23 = Panel(len_2)
panel_24 = Panel(len_3)
panel_25 = Panel(len_4)
panel_26 = Panel(len_5)
division = Division(A=panel_24, B=panel_17)
division_2 = Division(A=panel_23, B=panel_18)
division_3 = Division(A=panel_22, B=panel_20)
division_4 = Division(A=panel_25, B=panel_21)
division_5 = Division(A=panel_26, B=panel_19)
eval = EvaluateCurve(Curve=offset, Parameter=panel_23)  # -> Point, Tangent, Angle
eval_2 = EvaluateCurve(Curve=offset_5, Parameter=panel_25)  # -> Point, Tangent, Angle
eval_3 = EvaluateCurve(Curve=offset_3, Parameter=panel_24)  # -> Point, Tangent, Angle
eval_4 = EvaluateCurve(Curve=offset_2, Parameter=panel_26)  # -> Point, Tangent, Angle
eval_5 = EvaluateCurve(Curve=offset_4, Parameter=panel_22)  # -> Point, Tangent, Angle
pt = Point(<point referenced from the Rhino model>)
pt_2 = Point(<point referenced from the Rhino model>)
pt_3 = Point(<point referenced from the Rhino model>)
pt_4 = Point(<point referenced from the Rhino model>)
pt_5 = Point(<point referenced from the Rhino model>)
ln = Line(StartPoint=eval_5.Point, EndPoint=pt)
circle = CircleCNR(Center=eval_5.Point, Normal=Vector(0, 0, 1), Radius=panel_20)
circle_2 = CircleCNR(Center=eval_2.Point, Normal=Vector(0, 0, 1), Radius=panel_21)
circle_3 = CircleCNR(Center=eval_3.Point, Normal=Vector(0, 0, 1), Radius=panel_17)
ln_2 = Line(StartPoint=eval_2.Point, EndPoint=pt_2)
ln_3 = Line(StartPoint=eval_3.Point, EndPoint=pt_3)
circle_4 = CircleCNR(Center=eval.Point, Normal=Vector(0, 0, 1), Radius=panel_18)
circle_5 = CircleCNR(Center=eval_4.Point, Normal=Vector(0, 0, 1), Radius=panel_19)
ln_4 = Line(StartPoint=eval_4.Point, EndPoint=pt_4)
ln_5 = Line(StartPoint=eval.Point, EndPoint=pt_5)
scale = Scale(
    Geometry=[circle, circle_2, circle_3, circle_4, circle_5],
    Center=[eval_5.Point, eval_2.Point, eval_3.Point, eval.Point, eval_4.Point],
    Factor=Slider(0.615, range=0..3))  # -> Geometry, Transform

# ==== cluster Sensation
touch = ClusterInput()  # Touch
taste = ClusterInput()  # Taste
sound = ClusterInput()  # Sound
sight = ClusterInput()  # Sight
smell = ClusterInput()  # Smell
subtraction = Subtraction(A="100", B=sight, C=sound, D=smell, E=touch, F=taste)
num = Number([sight, sound, smell, touch, taste])
panel = Panel(num)
item = ListItem(List=num, Index=0, Wrap=True)
item_2 = ListItem(List=num, Index=3, Wrap=True)
item_3 = ListItem(List=num, Index=1, Wrap=True)
item_4 = ListItem(List=num, Index=2, Wrap=True)
item_5 = ListItem(List=num, Index=4, Wrap=True)
sight_2 = ClusterOutput(item)
sound_2 = ClusterOutput(item_3)
smell_2 = ClusterOutput(item_4)
taste_2 = ClusterOutput(item_5)
remaining_points = ClusterOutput(subtraction)  # Displays how many points are left over for sense distribution
touch_2 = ClusterOutput(item_2)
sensedata = ClusterOutput(num)  # A compiled list of Sense Input

# ==== cluster Sight
sense = ClusterInput()
num = Number(sense)
ma = MassAddition(Input=num)  # -> Result, PartialResults
total_sensation = ClusterOutput(ma.Result)
list = ClusterOutput(num)
